# Grasshopper definition 3D tile request.gh (Grasshopper 1.0.8)
# plug-ins: jSwan, RhinoCodePluginGH, Heron, Swiftlet

# ---- group: ADDRESS OF THE TILES YOU WANT TO GET
# {1}
panel = Panel("Van Mourik Broekmanweg 5, 2628 XE Delft, Netherlands")

# ----
# 5/7 Grafton Road, Auckland CBD, Auckland 1010
panel_2 = Panel("Fellenoord 15, Eindhoven, Netherlands")
restgeocode = ESRIRESTServiceGeocode(Addresses=panel)  # -> Candidates, flatten(Latitude), flatten(Longitude)
zoom_level = Panel("15")

# ---- group: API KEY
# {2}
google_3d_tiles_api_key = Panel("")

# ----
screen_space_error = Panel("8")
max_texture_size = Panel("4096")
item = ListItem(List=restgeocode.Latitude, Index=0, Wrap=True)
item_2 = ListItem(List=restgeocode.Longitude, Index=0, Wrap=True)
merge = Merge(
    Data1=item,
    Data2=item_2,
    Data3=zoom_level,
    Data4=google_3d_tiles_api_key,
    Data5=screen_space_error,
    Data6=max_texture_size)
panel_3 = Panel(merge)
panel_4 = Panel("""lat
lng
zoom
key
sse
texSize""")
rejsonkv = SerializeKeysAndValues(Key=panel_4, Value=panel_3)
txt = Text(rejsonkv)
ctb = CreateTextBody(Content=txt, IsHtmlChecked=False, IsJavascriptChecked=False, IsJsonChecked=True, IsTextChecked=False, IsXmlChecked=False)

# ---- group: TEMP WORKING DIRECTORY
# {3}
panel_5 = Panel("C:\Users\Admin\Desktop\")

# ----
req = HTTPRequest(URL="http://localhost:8080", Method="POST", Body=ctb)  # -> Status, Content, Response
data = Data(req.Content)
cs = CSharpScript(data=data, path=panel_5)  # -> out, successful, tilePath; inputs data: String, path: String
# ---------- cs: C# ----------
// Grasshopper Script Instance
using System;
using System.IO;
using System.Collections;
using System.Collections.Generic;
using System.Drawing;

using Rhino;
using Rhino.Geometry;

using Grasshopper;
using Grasshopper.Kernel;
using Grasshopper.Kernel.Data;
using Grasshopper.Kernel.Types;

using System.Linq;
using Rhino.DocObjects;
using Rhino.DocObjects.Tables;

public class Script_Instance : GH_ScriptInstance
{
  /* 
    Members:
      RhinoDoc RhinoDocument
      GH_Document GrasshopperDocument
      IGH_Component Component
      int Iteration

    Methods (Virtual & overridable):
      Print(string text)
      Print(string format, params object[] args)
      Reflect(object obj)
      Reflect(object obj, string method_name)
  */

  int index;
  List<Guid> ids;
  
  private void RunScript(
	string data,
	string path,
	ref object successful,
	ref object tilePath)
  {

    //remove this try and catch block if you want to keep the tiles from the previous request.
    
    try{
        RhinoDocument.Groups.Delete(index);
    }catch(Exception e){
        Print("There are no existing Tile groups to delete.");
    }
    

    // Write your logic here
    string textData = data;
    string filePath = path;

    // Append ".gltf" extension to the file path
    filePath = Path.Combine(path,"tile.gltf");

    bool success = SaveTextAsGltf(textData, filePath);
    
    successful = success; // true or false to determine the success
    tilePath = filePath;

    importGeo(filePath);
  }

  private bool SaveTextAsGltf(string textData, string filePath)
    {
        try
        {
            // Write text data to the specified .gltf file
            File.WriteAllText(filePath, textData);
            return true;
        }
        catch (Exception ex)
        {
            // Handle the exception (e.g., display an error message)
            Rhino.RhinoApp.WriteLine($"Error: {ex.Message}");
            return false;
        }
    }

    private void importGeo(string filePath){
        
        if(ids != null){
            RhinoDocument.Objects.Delete(ids,true);
        }      
        
        RhinoDoc.ActiveDoc.Objects.UnselectAll();
        string cmd = "!_-Import " + "\"" + filePath + "\"" + " _Enter";
        Rhino.RhinoApp.RunScript(cmd, false);

        var selectedObjs = RhinoDoc.ActiveDoc.Objects.GetSelectedObjects(false, false).ToList();

        ids = new List<Guid>();
        for(int i = 0; i < selectedObjs.Count; i++){
            ids.Add(selectedObjs[i].Attributes.ObjectId);
        }

        var doc = RhinoDoc.ActiveDoc;

        index = doc.Groups.Add(ids);
        doc.Views.Redraw();

    }

}
# ---------- end cs ----------
panel_6 = Panel(cs.out)
